# Grasshopper definition visulaization_script.gh (Grasshopper 1.0.7)
# plug-ins: Human

panel = Panel("C:\Users\Mostapha\Documents\code\ladybug-tools\honeybee-grasshopper\plugin\grasshopper\sampleFiles\xmls\diffuse50.xml")
panel_2 = Panel("C:\Users\Mostapha\Documents\code\ladybug-tools\honeybee-grasshopper\plugin\grasshopper\sampleFiles\xmls\clear.xml")

# ---- group: skylight
opaque = Brep(<brep referenced from the Rhino model>)

# ---- group: bottom_glazing
brep = Brep(<brep referenced from the Rhino model>)

# ---- group: opaque
opaque_2 = Brep([<brep referenced from the Rhino model> x9])

# ---- group: top_glazing
brep_2 = Brep(<brep referenced from the Rhino model>)

# ---- group: exterior
brep_3 = Brep([<brep referenced from the Rhino model> x2])

# ---- group: partition
opaque_3 = Brep(<brep referenced from the Rhino model>)

# ---- group: partition_glass
opaque_4 = Brep(<brep referenced from the Rhino model>)

# ----
radbsdfmat = HoneybeePlus_RadianceBSDFMaterial(xmlfile=panel, up_vec=Vector(0.01, 0.01, 1), thickness=0)  # -> material; plug-in component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
radbsdfmat_2 = HoneybeePlus_RadianceBSDFMaterial(xmlfile=panel_2, up_vec=Vector(0.01, 0.01, 1), thickness=0)  # -> material; plug-in component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
brep_4 = Brep(opaque_4)
radglassmat = HoneybeePlus_RadianceGlassMaterial(name="south_window_25", t_vis="0.25")  # -> material; plug-in component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
preview = CustomPreview(Geometry=brep_4, Material=ColourSwatch(SwatchColor=RGBA(13, 226, 255, 71)))
radglassmat_2 = HoneybeePlus_RadianceGlassMaterial(name="south_glass_top_60", t_vis="0.6")  # -> material; plug-in component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
brep_5 = Brep([brep_3, brep, opaque_2, opaque, opaque_3, opaque_4, brep_2])
wires = BrepWireframe(Brep=brep_5, Density=-1)
radglassmat_3 = HoneybeePlus_RadianceGlassMaterial(name="skylight_60", t_vis="0.60")  # -> material; plug-in component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
radglassmat_4 = HoneybeePlus_RadianceGlassMaterial(name="south_window_65", t_vis="0.65")  # -> material; plug-in component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
wingroupstate = HoneybeePlus_WindowGroupState(name="diffuse", rad_mat=radbsdfmat)  # -> report, state; plug-in component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
radglassmat_5 = HoneybeePlus_RadianceGlassMaterial(name="partition_glass_35", t_vis="0.35")  # -> material; plug-in component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
ext = ExtendCurve(Curve=wires, Type=0, Start="0.1", End="0.1")
hbwinsrf = HoneybeePlus_HoneybeeWindowSurface(geo=opaque, names="skylight", rad_mat=radglassmat_3)  # -> report, HB_win_srf; plug-in component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
hbwinsrf_2 = HoneybeePlus_HoneybeeWindowSurface(geo=brep_2, names="south_glass_top", rad_mat=radglassmat_2)  # -> report, HB_win_srf; plug-in component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
hbwingroup = HoneybeePlus_HoneybeeWindowGroup(geo=brep, name="south_window", rad_mat=radbsdfmat_2, states=wingroupstate.state)  # -> report, HB_win_group; plug-in component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
hbwinsrf_3 = HoneybeePlus_HoneybeeWindowSurface(geo=opaque_4, names="partition_glass", rad_mat=radglassmat_5)  # -> report, HB_win_srf; plug-in component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
hbsurface = HoneybeePlus_HoneybeeSurface(geo=brep_3, names="context", type="6")  # -> report, HB_srf; plug-in component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
hbsurface_2 = HoneybeePlus_HoneybeeSurface(geo=opaque_2, names="room_geometry")  # -> report, HB_srf; plug-in component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
hbsurface_3 = HoneybeePlus_HoneybeeSurface(geo=opaque_3, names="partition")  # -> report, HB_srf; plug-in component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
path = FilePath("C:\EnergyPlusV8-6-0\WeatherData\USA_CA_San.Francisco.Intl.AP.724940_TMY3.epw")
wea = HoneybeePlus_WEAFromEPW(epw_file=path)  # -> wea; plug-in component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
list = ItemSelector(
    opaque_2,
    {"Referenced Brep", "Referenced Brep", "Referenced Brep", "Referenced Brep", "Referenced Brep", "Referenced Brep", "Referenced Brep", "Referenced Brep", "Referenced Brep"}, selected="Referenced Brep")
skymatrix = HoneybeePlus_SkyMatrix(name="sky_matrix", north=0, wea=wea, density=1)  # -> skymtx; plug-in component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
flip = Flip(Surface=list)  # -> Surface, Result
gentestpts = Honeybee_GenerateTestPoints(testGeometry=flip.Surface, gridSize="0.1", distBaseSrf="0.9", moveTestMesh=True)  # -> readMe, simplify(testPoints), simplify(ptsVectors), simplify(facesArea), simplify(mesh); plug-in component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
panel_3 = Panel("C:\Users\Mostapha\Documents\code\ladybug-tools\radiance-folder-structure\project_folder\5-output\daylight-factor.dat")
flatten = FlattenTree(
    Tree=[hbsurface.HB_srf, hbwinsrf_2.HB_win_srf, hbwinsrf_3.HB_win_srf, hbsurface_2.HB_srf, hbwinsrf.HB_win_srf, hbsurface_3.HB_srf],
    Path="{0}")
toggle = BooleanToggle(False)
analysisgrid = HoneybeePlus_AnalysisGrid(name="room", test_points=gentestpts.testPoints, pts_vectors=gentestpts.ptsVectors)  # -> analysis_grid; plug-in component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
dfrecipe = HoneybeePlus_DaylightFactorRecipe(analysis_grids=analysisgrid)  # -> analysis_recipe; plug-in component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
runradiance = HoneybeePlus_RunRadianceAnalysis(analysis_recipe=dfrecipe, HB_objects=flatten, folder="c:\ladybug", name="sample_case", write=toggle, run=toggle)  # -> report, legend_par, outputs; plug-in component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
fivephasegbrecipe = HoneybeePlus_GridBasedFivePhaseDaylightRecipe(skymtx=skymatrix, analysis_grids=analysisgrid, analysis_type=0, reuse_vmtx=False, reuse_dmtx=False)  # -> analysis_recipe; plug-in component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
legendpar = Ladybug_LegendParameters(highBound="5")  # -> legendPar; plug-in component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
hourlyvalues = HoneybeePlus_HourlyValues(analysis_grid=runradiance.outputs)  # -> report, values; plug-in component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
file = ReadFile(File=panel_3, PerLineParse=True)
ladybug = Ladybug_Ladybug()  # -> Vviiiiiiiiiizzz; plug-in component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
recolormesh = Ladybug_RecolorMesh(inputMesh=gentestpts.mesh, legendPar=legendpar)  # -> readMe, newMesh, newLegend, legendBasePt, meshColors, legendColors; plug-in component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
